% Simulink data dictionary TorqueCommand.sldd

Profile = enum(DefaultValue="Default")
  Default = 0
  Driver1 = 1
  Driver2 = 2
  Driver3 = 3
  Driver4 = 4
  Testing1 = 5
  Testing2 = 6
  Testing3 = 7
  Testing4 = 8
  Testing5 = 9
  Testing6 = 10

Curve = enum(DefaultValue="Default")
  Default = 0
  Matt = 1  % Curve for Matt's Preference
  Casey = 2  % Curve for Casey's Preference
  Noah = 3  % Curve for Noah's Preference
  Carter = 4  % Curve for Carter's Preference
  Lim150 = 5  % Copped at 150Nm
  Lim100 = 6  % Capped at 100Nm